# Grasshopper definition gridLaserCut.gh (Grasshopper 0.9.76)

Y = Slider(20, range=14..22)
grid_square = Slider(0.6415, range=0..2)
grid_gap = Slider(0.0915, range=0..2)
X = Slider(22, range=14..23)
multiplication = Multiplication(A=grid_square, B=2)
multiplication_2 = Multiplication(A="15.12", B="2")
box = CenterBox(Base=PlaneXY(0, 0, 0), X="15.12", Y="15.12", Z=1)
addition = Addition(A=grid_gap, B=multiplication)
sqgrid = Square(Plane=PlaneXY(0, 0, 0), Size=addition, ExtentX=X, ExtentY=Y)  # -> Cells, Points
bbox = BoundingBox(Content=flatten(sqgrid.Cells), Plane=PlaneXY(0, 0, 0), UnionBox=True)  # -> Box, Box_2
eval = Evaluate(F="(x-y*1.283)/y", x=multiplication_2, y=X)
pcen = PolygonCenter(Polyline=sqgrid.Cells)  # -> CenterV, CenterE, CenterA
box_corners = BoxCorners(Box=bbox.Box)  # -> CornerA, CornerB, CornerC, CornerD, CornerE, CornerF, CornerG, CornerH
panel = Panel(eval)
planesrf = PlaneSurface(Plane=PlaneXY(0, 0, 0), XSize=multiplication_2, YSize=multiplication_2)
xy = XYPlane(Origin=pcen.CenterV)
vec = VectorXYZ(XComponent=-15.12, YComponent=0, ZComponent=0)  # -> Vector, Length
rec_2pt = Rectangle2Pt(Plane=PlaneXY(0, 0, 0), PointA=box_corners.CornerA, PointB=box_corners.CornerB, Radius=0)  # -> Rectangle, Length
box_2 = CenterBox(Base=xy, X=grid_square, Y=grid_square, Z=1)
move = Move(Geometry=planesrf, Motion=vec.Vector)  # -> Geometry, Transform
pcen_2 = PolygonCenter(Polyline=rec_2pt.Rectangle)  # -> CenterV, CenterE, CenterA
neg = Negative(Value=pcen_2.CenterV)
move_2 = Move(Geometry=box_2, Motion=neg)  # -> flatten(Geometry), Transform
boxrec = BoxRectangle(Rectangle=move.Geometry, Height="3/16")
sdiff = SolidDifference(BrepsA=boxrec)
