# Grasshopper definition StandardisedTable.gh (Grasshopper 0.9.76)

table_height = Slider(31.5, range=28..32)

# ---- group: TableHeight (constant)
panel = Panel("31")

# ---- group: Lego Unit NxN
number_slider = Slider(96, range=90..200)

# ----
vec = VectorXYZ(XComponent=0, YComponent=0, ZComponent=table_height)  # -> Vector, Length
multiplication = Multiplication(A=number_slider, B=0.315)
xy = XYPlane(Origin=vec.Vector)
acrylicthickness = Slider(0.75, range=0..1)
rectangle = Rectangle(Plane=xy, XSize=multiplication, YSize=multiplication, Radius=0)  # -> Rectangle, Length
neg = Negative(Value=acrylicthickness)
edge_offset = Slider(0.23, range=0..20)
subtraction = Subtraction(A=table_height, B=acrylicthickness)
neg_2 = Negative(Value=edge_offset)
vec_2 = VectorXYZ(XComponent=edge_offset, YComponent=edge_offset, ZComponent=0)  # -> Vector, Length
vec_3 = VectorXYZ(XComponent=neg_2, YComponent=edge_offset, ZComponent=0)  # -> Vector, Length
vec_4 = VectorXYZ(XComponent=neg_2, YComponent=neg_2, ZComponent=0)  # -> Vector, Length
vec_5 = VectorXYZ(XComponent=edge_offset, YComponent=neg_2, ZComponent=0)  # -> Vector, Length
neg_3 = Negative(Value=subtraction)
Z = UnitZ(Factor=neg_3)
extr = Extrude(Base=<curve referenced from the Rhino model>, Direction=Z)
vec_6 = VectorXYZ(XComponent="-.704", YComponent="0.1875", ZComponent="-2.5")  # -> Vector, Length
vec_7 = VectorXYZ(XComponent="-.704", YComponent="0.1875", ZComponent="5.907")  # -> Vector, Length
vec_8 = VectorXYZ(XComponent=".1875/2", YComponent=0, ZComponent=0)  # -> Vector, Length
vec_9 = VectorXYZ(XComponent=".1875/2", YComponent=0, ZComponent=0)  # -> Vector, Length

# ---- group: Mounting Plate / Mounting plate
brep = Brep(<brep referenced from the Rhino model>)

# ---- group: Mounting Plate
pt = ConstructPoint(XCoordinate=1.77, YCoordinate=3.98, ZCoordinate=6.82)
vec_10 = VectorXYZ(XComponent=0, YComponent=2.947, ZComponent=0)  # -> Vector, Length
move = Move(Geometry=brep, Motion=pt)  # -> Geometry, Transform
move_2 = Move(Geometry=pt, Motion=vec_10.Vector)  # -> Geometry, Transform
xy_2 = XYPlane(Origin=[move_2.Geometry, pt])

# ---- group: BakeWorthy Geometry
boxrec = BoxRectangle(Rectangle=rectangle.Rectangle, Height=neg)

# ----
box_corners = BoxCorners(Box=boxrec)  # -> CornerA, CornerB, CornerC, CornerD, CornerE, CornerF, CornerG, CornerH
move_3 = Move(Geometry=box_corners.CornerA, Motion=vec_2.Vector)  # -> Geometry, Transform
move_4 = Move(Geometry=box_corners.CornerB, Motion=vec_3.Vector)  # -> Geometry, Transform
move_5 = Move(Geometry=box_corners.CornerC, Motion=vec_4.Vector)  # -> Geometry, Transform
move_6 = Move(Geometry=box_corners.CornerD, Motion=vec_5.Vector)  # -> Geometry, Transform
pl_3pt = Plane3Pt(PointA=move_3.Geometry, PointB=move_6.Geometry, PointC=move_4.Geometry)
pl_3pt_2 = Plane3Pt(PointA=move_6.Geometry, PointB=move_5.Geometry, PointC=move_3.Geometry)
pl_3pt_3 = Plane3Pt(PointA=move_5.Geometry, PointB=move_4.Geometry, PointC=move_6.Geometry)
pl_3pt_4 = Plane3Pt(PointA=move_4.Geometry, PointB=move_3.Geometry, PointC=move_5.Geometry)
move_7 = Move(Geometry=move_4.Geometry, Motion=Vector(0, 0, 10))  # -> Geometry, Transform
move_8 = Move(Geometry=move_5.Geometry, Motion=Vector(0, 0, 10))  # -> Geometry, Transform
move_9 = Move(Geometry=extr, Motion=move_3.Geometry)  # -> Geometry, Transform
move_10 = Move(Geometry=move_3.Geometry, Motion=Vector(0, 0, 10))  # -> Geometry, Transform
ln = Line(StartPoint=move_8.Geometry, EndPoint=move_5.Geometry)
ln_2 = Line(StartPoint=move_7.Geometry, EndPoint=move_4.Geometry)
ln_3 = Line(StartPoint=move_10.Geometry, EndPoint=move_3.Geometry)

# ---- group: Side panel on ground
subtraction_2 = Subtraction(A="4.936", B=table_height)
subtraction_3 = Subtraction(A=multiplication, B="1.531")
vec_11 = VectorXYZ(XComponent=subtraction_3, YComponent=subtraction_2, ZComponent="-.1875")  # -> Vector, Length
rec_2pt = Rectangle2Pt(Plane=PlaneXY(0, 0, 0), PointA=Point(0, 0, 0), PointB=vec_11.Vector, Radius=0.5)  # -> Rectangle, Length
extr_2 = Extrude(Base=rec_2pt.Rectangle, Direction=Vector(0, 0, -0.1875))
cap = CapHoles(Brep=extr_2)
vec_12 = VectorXYZ(XComponent=".5", YComponent="-.5", ZComponent="-.375")  # -> Vector, Length
xy_3 = XYPlane(Origin=vec_12.Vector)

# ---- group: Legs
cap_2 = CapHoles(Brep=move_9.Geometry)
orient = Orient(Geometry=cap_2, Source=pl_3pt, Target=pl_3pt_2)  # -> Geometry, Transform
orient_2 = Orient(Geometry=cap_2, Source=pl_3pt, Target=pl_3pt_4)  # -> Geometry, Transform

# ----
bbox = BoundingBox(Content=cap_2, Plane=PlaneXY(0, 0, 0))  # -> Box, Box_2
box_corners_2 = BoxCorners(Box=bbox.Box)  # -> CornerA, CornerB, CornerC, CornerD, CornerE, CornerF, CornerG, CornerH
pl_3pt_5 = Plane3Pt(PointA=box_corners_2.CornerA, PointB=box_corners_2.CornerC, PointC=box_corners_2.CornerE)
brep_2 = Brep(cap_2)

# ---- group: Side panel
vec_13 = VectorXYZ(XComponent="-.246", YComponent="0", ZComponent="2")  # -> Vector, Length
pl_3pt_6 = Plane3Pt(PointA=move_3.Geometry, PointB=move_5.Geometry, PointC=Point(0, 0, 0))
subtraction_4 = Subtraction(A=subtraction_2, B="-1")
vec_14 = VectorXYZ(XComponent=0, YComponent=0, ZComponent=subtraction_4)  # -> Vector, Length

# ---- group: BakeWorthy Geometry (continued)
move_11 = Move(Geometry=box_corners_2.CornerB, Motion=vec_7.Vector)  # -> Geometry, Transform
mirror = Mirror(Geometry=move_11.Geometry, Plane=pl_3pt_5)  # -> Geometry, Transform
move_12 = Move(Geometry=box_corners_2.CornerF, Motion=vec_6.Vector)  # -> Geometry, Transform
mirror_2 = Mirror(Geometry=move_12.Geometry, Plane=pl_3pt_5)  # -> Geometry, Transform
orient_3 = Orient(Geometry=mirror_2.Geometry, Source=pl_3pt, Target=pl_3pt_2)  # -> Geometry, Transform
orient_4 = Orient(Geometry=mirror.Geometry, Source=pl_3pt, Target=pl_3pt_2)  # -> Geometry, Transform
orient_5 = Orient(Geometry=move_11.Geometry, Source=pl_3pt, Target=pl_3pt_2)  # -> Geometry, Transform
orient_6 = Orient(Geometry=move_12.Geometry, Source=pl_3pt, Target=pl_3pt_2)  # -> Geometry, Transform
orient_7 = Orient(Geometry=mirror_2.Geometry, Source=pl_3pt, Target=pl_3pt_3)  # -> Geometry, Transform
orient_8 = Orient(Geometry=mirror.Geometry, Source=pl_3pt, Target=pl_3pt_3)  # -> Geometry, Transform
orient_9 = Orient(Geometry=move_11.Geometry, Source=pl_3pt, Target=pl_3pt_3)  # -> Geometry, Transform
orient_10 = Orient(Geometry=move_12.Geometry, Source=pl_3pt, Target=pl_3pt_3)  # -> Geometry, Transform
orient_11 = Orient(Geometry=mirror_2.Geometry, Source=pl_3pt, Target=pl_3pt_4)  # -> Geometry, Transform
orient_12 = Orient(Geometry=mirror.Geometry, Source=pl_3pt, Target=pl_3pt_4)  # -> Geometry, Transform
orient_13 = Orient(Geometry=move_11.Geometry, Source=pl_3pt, Target=pl_3pt_4)  # -> Geometry, Transform
orient_14 = Orient(Geometry=move_12.Geometry, Source=pl_3pt, Target=pl_3pt_4)  # -> Geometry, Transform

# ----
pt_2 = Point(orient_6.Geometry)
pt_3 = Point(orient_5.Geometry)
ln_4 = Line(StartPoint=move_12.Geometry, EndPoint=orient_11.Geometry)
pt_4 = Point(mirror.Geometry)

vec_15 = VectorXYZ(XComponent=0, YComponent=[".704", "-.704"], ZComponent="-.9")  # -> Vector, Length
move_13 = Move(Geometry=[pt_3, pt_4], Motion=vec_15.Vector)  # -> Geometry, Transform
xz = XZPlane(Origin=move_13.Geometry)
xy_4 = XYPlane(Origin=Point(0, 0, 0))
B = Base(<curve referenced from the Rhino model>)
xy_5 = XYPlane(Origin=move_13.Geometry)
orient_15 = Orient(Geometry=B, Source=xy_4, Target=xz)  # -> Geometry, Transform
planesrf = PlaneSurface(Plane=xz, XSize=Domain(-10, 10), YSize=Domain(-10, 10))
loft = Loft(
    Curves=orient_15.Geometry,
    Options={Adjust=False, Closed=False, LoftEnds=0, LoftSimp=0, LoftType=0, Rebuild=10, Refit=0.01})
rotate = Rotate(Geometry=planesrf, Angle=degrees([-45, 225]), Plane=xy_5)  # -> Geometry, Transform
cap_3 = CapHoles(Brep=loft)
sdiff = SolidDifference(BrepsA=cap_3, BrepsB=rotate.Geometry)
brep_3 = Brep(sdiff)

pt_5 = Point(mirror_2.Geometry)
ln_5 = Line(StartPoint=mirror_2.Geometry, EndPoint=orient_6.Geometry)
len = Length(Curve=ln_5)
pt_6 = Point(move_12.Geometry)
pt_7 = Point(move_11.Geometry)
len_2 = Length(Curve=ln_4)
pcen = PolygonCenter(Polyline=ln_5)  # -> CenterV, CenterE, CenterA
addition = Addition(A=len, B="1.408")
pcen_2 = PolygonCenter(Polyline=ln_4)  # -> CenterV, CenterE, CenterA
pt_8 = Point(orient_12.Geometry)
addition_2 = Addition(A=len_2, B="1.408")
pt_9 = Point(orient_11.Geometry)

# ---- group: Bottom tie drill
vec_16 = VectorXYZ(XComponent=0, YComponent=0, ZComponent=".4")  # -> Vector, Length
pt_10 = Point(orient_5.Geometry)
vec_17 = VectorXYZ(XComponent=0, YComponent=0, ZComponent="-.4")  # -> Vector, Length
pt_11 = Point(mirror.Geometry)
move_14 = Move(Geometry=[pt_10, pt_11], Motion=vec_16.Vector)  # -> Geometry, Transform
move_15 = Move(Geometry=[pt_10, pt_11], Motion=vec_17.Vector)  # -> Geometry, Transform
yz = YZPlane(Origin=[move_14.Geometry, move_15.Geometry])
cyl = Cylinder(Base=yz, Radius=0.16, Length=-1)
cyl_2 = Cylinder(Base=[yz, xy_2], Radius=0.16, Length=1)  # -> flatten(Cylinder)
sdiff_2 = SolidDifference(BrepsA=brep_3, BrepsB=cyl_2)

# ----
division = Division(A=addition, B=2)
division_2 = Division(A=addition_2, B=2)
box = CenterBox(Base=pcen.CenterV, X="3/32", Y=division, Z=".75")
box_2 = CenterBox(Base=pcen_2.CenterV, X="3/32", Y=division_2, Z=".75")
move_16 = Move(Geometry=box, Motion=vec_8.Vector)  # -> Geometry, Transform
move_17 = Move(Geometry=box_2, Motion=vec_9.Vector)  # -> Geometry, Transform

vec_18 = VectorXYZ(XComponent=[".704", "-.704"], YComponent=0, ZComponent="-.9")  # -> Vector, Length
move_18 = Move(Geometry=[pt_8, pt_7], Motion=vec_18.Vector)  # -> Geometry, Transform
xy_6 = XYPlane(Origin=Point(0, 0, 0))
B_2 = Base(<curve referenced from the Rhino model>)
yz_2 = YZPlane(Origin=move_18.Geometry)
orient_16 = Orient(Geometry=B_2, Source=xy_6, Target=yz_2)  # -> Geometry, Transform
loft_2 = Loft(
    Curves=orient_16.Geometry,
    Options={Adjust=False, Closed=False, LoftEnds=0, LoftSimp=0, LoftType=0, Rebuild=10, Refit=0.01})
cap_4 = CapHoles(Brep=loft_2)
planesrf_2 = PlaneSurface(Plane=yz_2, XSize=Domain(-10, 10), YSize=Domain(-10, 10))
xy_7 = XYPlane(Origin=move_18.Geometry)
rotate_2 = Rotate(Geometry=planesrf_2, Angle=degrees([225, -45]), Plane=xy_7)  # -> Geometry, Transform
sdiff_3 = SolidDifference(BrepsA=cap_4, BrepsB=rotate_2.Geometry)
brep_4 = Brep(sdiff_3)

xz_2 = XZPlane(Origin=[pt_6, pt_9])
yz_3 = YZPlane(Origin=[pt_2, pt_5])
xy_8 = XYPlane(Origin=pcen_2.CenterV)
rotate_3 = Rotate(Geometry=move_17.Geometry, Angle=1.570796327, Plane=xy_8)  # -> Geometry, Transform

# ---- group: Legs (continued)
orient_17 = Orient(Geometry=[move_16.Geometry, brep_3, rotate_3.Geometry, brep_4, cap_2], Source=pl_3pt, Target=pl_3pt_3)  # -> Geometry, Transform

# ----
cyl_3 = Cylinder(Base=yz_3, Radius=0.16, Length=1)
cyl_4 = Cylinder(Base=xz_2, Radius=0.16, Length=-1)
xz_3 = XZPlane(Origin=pcen_2.CenterV)
cyl_5 = Cylinder(Base=yz_3, Radius=0.16, Length=-1)
cyl_6 = Cylinder(Base=xz_2, Radius=0.16, Length=1)

# ---- group: Bottom tie drill
pt_12 = Point(orient_12.Geometry)
pt_13 = Point(move_11.Geometry)
vec_19 = VectorXYZ(XComponent=0, YComponent=0, ZComponent=".4")  # -> Vector, Length
vec_20 = VectorXYZ(XComponent=0, YComponent=0, ZComponent="-.4")  # -> Vector, Length
move_19 = Move(Geometry=[pt_12, pt_13], Motion=vec_19.Vector)  # -> Geometry, Transform
move_20 = Move(Geometry=[pt_12, pt_13], Motion=vec_20.Vector)  # -> Geometry, Transform
xz_4 = XZPlane(Origin=[move_19.Geometry, move_20.Geometry])
cyl_7 = Cylinder(Base=xz_4, Radius=0.16, Length=-1)
cyl_8 = Cylinder(Base=xz_4, Radius=0.16, Length=1)
sdiff_4 = SolidDifference(BrepsA=brep_4, BrepsB=cyl_7)

# ----
cyl_9 = Cylinder(Base=xz_3, Radius=0.12, Length=-1)

# ---- group: Side panel (continued)
move_21 = Move(Geometry=pt_6, Motion=vec_13.Vector)  # -> Geometry, Transform
mirror_3 = Mirror(Geometry=move_21.Geometry, Plane=pl_3pt_6)  # -> Geometry, Transform
xz_5 = XZPlane(Origin=move_21.Geometry)
yz_4 = YZPlane(Origin=mirror_3.Geometry)
cyl_10 = Cylinder(Base=[xz_5, yz_4], Radius=0.12, Length=[1, -1])
orient_18 = Orient(Geometry=cyl_10, Source=pl_3pt, Target=pl_3pt_2)  # -> Geometry, Transform
orient_19 = Orient(Geometry=cyl_10, Source=pl_3pt, Target=pl_3pt_3)  # -> Geometry, Transform
orient_20 = Orient(Geometry=cyl_10, Source=pl_3pt, Target=pl_3pt_4)  # -> Geometry, Transform
move_22 = Move(Geometry=[cyl_10, orient_18.Geometry, orient_19.Geometry, orient_20.Geometry], Motion=vec_14.Vector)  # -> Geometry, Transform

# ---- group: Side panel on ground (continued)
orient_21 = Orient(Geometry=cap, Source=xy_3, Target=xz_5)  # -> Geometry, Transform

# ---- group: Side panel (continued)
sdiff_5 = SolidDifference(BrepsA=orient_21.Geometry, BrepsB=[move_22.Geometry, cyl_10, orient_20.Geometry])
orient_22 = Orient(Geometry=sdiff_5, Source=pl_3pt, Target=[pl_3pt_2, pl_3pt_3, pl_3pt_4])  # -> Geometry, Transform

# ---- group: BakeWorthy Geometry (continued)
sdiff_6 = SolidDifference(BrepsA=move_16.Geometry, BrepsB=cyl_3)
sdiff_7 = SolidDifference(BrepsA=rotate_3.Geometry, BrepsB=[cyl_4, cyl_9])
sdiff_8 = SolidDifference(BrepsA=brep_2, BrepsB=[cyl, cyl_8, cyl_5, cyl_6, cyl_10, move_22.Geometry])
orient_23 = Orient(Geometry=sdiff_8, Source=pl_3pt, Target=[pl_3pt_2, pl_3pt_3, pl_3pt_4])  # -> Geometry, Transform
orient_24 = Orient(Geometry=[sdiff_4, sdiff_2, sdiff_6, sdiff_7], Source=pl_3pt, Target=pl_3pt_3)  # -> Geometry, Transform
